# Grasshopper definition test.gh (Grasshopper 1.0.7)
# plug-ins: FloorPlanGenerator, MeshEdit Components

curve = Curve(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)
point = Point(Point(4.988554165, -3.201871598, 0))
houseinstance = HouseInstance(Boundary=curve, EntrancePoint=point)
roominstance = RoomInstance()
roominstance_2 = RoomInstance()
number_slider = Slider(4, range=0..10)
trigger = Trigger(Interval=20, TimerInterval=20, Target=magnetizingrooms_heapes)  # disabled
roominstance_3 = RoomInstance()
number_slider_2 = Slider(0, range=0..10)
series = Series(Start=0, Step=1, Count=number_slider)
magnetizingrooms_heapes = MagnetizingRooms_HeapES(
    HouseInstance=houseinstance,
    Iterations=Slider(200, range=0..1000),
    MaxAdjDistance=Slider(3, range=0..10),
    DisplayNumber=number_slider,
    GapOfResult=Slider(1, range=0..10))  # -> Corridors, RoomBreps, RoomNames, Adjacencies, MissingAdjacences
unit_x = UnitX(Factor=Slider(31, range=0..100))
roominstance_4 = RoomInstance()
multiplication = Multiplication(A=unit_x, B=series)
tree_branch = TreeBranch(Tree=magnetizingrooms_heapes.Corridors, Path=number_slider_2, MaintainPaths=True)
tree_branch_2 = TreeBranch(Tree=magnetizingrooms_heapes.RoomNames, Path=number_slider_2, MaintainPaths=True)
tree_branch_3 = TreeBranch(Tree=magnetizingrooms_heapes.RoomBreps, Path=number_slider_2, MaintainPaths=True)
tree_branch_4 = TreeBranch(Tree=magnetizingrooms_heapes.Adjacencies, Path=number_slider_2, MaintainPaths=True)
tree_branch_5 = TreeBranch(Tree=magnetizingrooms_heapes.MissingAdjacences, Path=number_slider_2, MaintainPaths=True)
move = Move(Geometry=magnetizingrooms_heapes.Corridors, Motion=graft(multiplication))  # -> Geometry, Transform
move_2 = Move(Geometry=magnetizingrooms_heapes.RoomBreps, Motion=graft(multiplication))  # -> Geometry, Transform
brep = Brep(tree_branch)

# ---- group: Display cluster
cluster = Cluster(brep_2=tree_branch, brep=tree_branch_3, txt_2=tree_branch_2, txt=tree_branch_4, int=tree_branch_5)

# ----
brep_2 = Brep(tree_branch_3)
list_item = ListItem(List=tree_branch_3, Index=Slider(0, range=0..10), Wrap=True)
brep_3 = Brep(tree_branch)
merge = Merge(Data1="corridor", Data2=tree_branch_2)
custom_preview = CustomPreview(Geometry=brep, Material=ColourSwatch(SwatchColor=RGB(255, 255, 255)))
merge_2 = Merge(Data1=brep_3, Data2=brep_2)
cluster_2 = Cluster(
    brep_2=move.Geometry,
    brep=move_2.Geometry,
    txt_2=magnetizingrooms_heapes.RoomNames,
    txt=magnetizingrooms_heapes.Adjacencies,
    int=magnetizingrooms_heapes.MissingAdjacences)
join = BrepJoin(Breps=flatten([brep_3, brep_2]))  # -> Breps, Closed
item = ListItem(List=brep_2, Index=0, Wrap=True)
edges = BrepEdges(Brep=brep_2)  # -> Naked, Interior, NonManifold
branch = TreeBranch(Tree=edges.Naked, Path="{0;0}", MaintainPaths=True)
area = MeshArea(Mesh=brep_2)  # -> Area, Centroid
item_2 = ListItem(List=branch, Index=0, Wrap=True)
edges_2 = BrepEdges(Brep=join.Breps)  # -> Naked, Interior, NonManifold
item_3 = ListItem(List=area.Centroid, Index=0, Wrap=True)
custom_preview_2 = CustomPreview(Geometry=list_item, Material=ColourSwatch(SwatchColor=RGB(0, 255, 30)))
panel = Panel("""4
2
3
2""")
crv = Curve(edges_2.Naked)
line = Line(edges_2.Naked)
genes = GenePool(
    Decimals=1,
    Maximum=1,
    Minimum=0.1,
    Value=[0.628438053, 0.7583473145, 0.7022583107, 0.1542322484, 0.3246406449, 0.3893140959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])
Z = UnitZ(Factor=Slider(2.8, range=0..10))
c_script = CSharpScript(
    boundary=line,
    roomsBoundary=edges.Naked,
    centerPoint=area.Centroid,
    roomName=tree_branch_2,
    roomDaylightFactor=panel,
    genePool=genes)  # -> out, A, B, FloorPolyLines, y1, Kc, Gc, Fitness; inputs boundary: list of Line, roomsBoundary: tree of Line, centerPoint: list of Point3d, roomName: list of String, roomDaylightFactor: list of Double, genePool: list of Double
# ---------- c_script: C# usings ----------
using System.Linq;
# ---------- c_script: C# ----------
    A = ClassifyLines(boundary, roomsBoundary);

    List<Wall> walls = new List<Wall>();
    walls = GetWalls(ClassifyLines(boundary, roomsBoundary), centerPoint, roomName);

    List<Line> north = new List<Line>();

    //List<Line> lines = walls.Branch(0).Where(x => x.Direction == Direction.North).Select(x => x.Line).ToList();

    List<Line> lines = walls.Where(x => x.Direction != Direction.Unset).Where(x => x.RoomName == "Room 0").Select(x => x.Line).ToList();

    B = lines;


    Floor floor = new Floor(walls, roomName, roomDaylightFactor, genePool);

    FloorPolyLines = floor.FloorPolylines;

    y1 = floor.Y1;
    Kc = floor.KC;
    Gc = floor.GC;

    Fitness = floor.Fitness;
# ---------- c_script: C# additional code ----------
  public DataTree<Line> ClassifyLines(List<Line> boundary, DataTree<Line> roomsBoundary)
  {
    DataTree<Line> classifyLines = new DataTree<Line>();


    for (int i = 0; i < roomsBoundary.BranchCount; i++)
    {
      List<Line> lines = new List<Line>();
      for (int j = 0; j < roomsBoundary.Branches[i].Count; j++)
      {
        for (int k = 0; k < boundary.Count; k++)
        {
          if (IsSameLine(boundary[k], roomsBoundary.Branches[i][j]))
          {
            lines.Add(boundary[k]);
          }
        }
      }
      classifyLines.AddRange(lines, new GH_Path(i));

    }
    return classifyLines;
  }

  public bool IsSameLine(Line a, Line b)
  {
    return (a.From == b.From && a.To == b.To) || (a.From == b.To && a.To == b.From);
  }


  public enum Direction{ Unset,South, West,North,East};

  public Direction GetDirection(Point3d centerPoint, Line line)
  {
    Point3d pointA = line.From;
    Point3d pointB = line.To;

    if(pointA.X == pointB.X && pointA.X < centerPoint.X)
      return Direction.West;
    else if (pointA.X == pointB.X && pointA.X >= centerPoint.X)
      return Direction.East;
    else if(pointA.Y == pointB.Y && pointA.Y >= centerPoint.Y)
      return Direction.North;
    else if(pointA.Y == pointB.Y && pointA.Y < centerPoint.Y)
      return Direction.South;
    else
      return Direction.Unset;
  }


  public List<Wall> GetWalls (DataTree<Line> lines, List<Point3d> centerPoint, List<string> names)
  {
    List<Wall> result = new List<Wall>();

    for (int i = 0; i < lines.BranchCount; i++)
    {
      List<Wall> walls = new List<Wall>();

      for (int j = 0; j < lines.Branches[i].Count; j++)
      {
        Wall wall = new Wall();
        wall.RoomName = names[i];
        wall.Line = lines.Branches[i][j];
        wall.Direction = GetDirection(centerPoint[i], wall.Line);

        walls.Add(wall);
      }

      result.AddRange(walls);
    }
    return result;
  }


  public class Wall
  {
    public Line Line = new Line();
    public Direction Direction ;
    public string RoomName = "";

  }



  //根据采光系数表，得到的一个矩阵（进深4.8m, 层高3.0m）的数值，根据这个矩阵，用采光系数与Kc值，算出Gc值
  public static double[,] CavMatrix =
    {
    { 1.3, 1.6, 1.9,2.1,2.3 },
    {1.8,2.2,2.6,2.9,3.2 },
    {2.2,2.7,3.1,3.5,3.9 },
    {2.7,3.2,3.7,4.2,4.7 }
    };

  public class Floor
  {
    public List<Wall> WestWall;
    public List<Wall> NorthWall;
    public List<Wall> EastWall;
    public List<Wall> SouthWall;

    public List<string> RoomName;

    public List<double> DayLightFactor;
    public List<double> GenePool;

    public double Fitness;

    public DataTree<Polyline> FloorPolylines;
    public DataTree<double> Y1;
    public DataTree<double> KC;
    public DataTree<double> GC;

    public Floor(List<Wall> walls, List<string> roomName, List<double> dayLightFactor, List<double> genePool)
    {
      WestWall = walls.Where(x => x.Direction == Direction.West).Select(x => x).ToList();
      NorthWall = walls.Where(x => x.Direction == Direction.North).Select(x => x).ToList();
      EastWall = walls.Where(x => x.Direction == Direction.East).Select(x => x).ToList();
      SouthWall = walls.Where(x => x.Direction == Direction.South).Select(x => x).ToList();

      RoomName = roomName;
      DayLightFactor = dayLightFactor;
      GenePool = genePool;

      FloorPolylines = GetLinesInEachDirection();

      Fitness = DataProcess();
    }

    public DataTree<Polyline> GetLinesInEachDirection()
    {
      DataTree<Polyline> result = new DataTree<Polyline>();


      result.AddRange(GetLinesByNames(WestWall), new GH_Path(0));
      result.AddRange(GetLinesByNames(NorthWall), new GH_Path(1));
      result.AddRange(GetLinesByNames(EastWall), new GH_Path(2));
      result.AddRange(GetLinesByNames(SouthWall), new GH_Path(3));

      return result;
    }


    public List<Polyline> GetLinesByNames(List<Wall> walls)
    {
      List<Polyline> result = new List<Polyline>();

      foreach (string name in RoomName)
      {
        Polyline polyline = new Polyline(); // 合并后的多段线
        // 用于存储已添加的点的集合
        HashSet<Point3d> addedPoints = new HashSet<Point3d>();
        for (int i = 0; i < walls.Count; i++)
        {
          if (name == walls[i].RoomName)
          {
            var line = walls[i].Line;

            Point3d startPoint = line.From;
            Point3d endPoint = line.To;

            // 检查起点是否已添加
            if (!addedPoints.Contains(startPoint))
            {
              addedPoints.Add(startPoint);
            }
            // 检查终点是否已添加
            if (!addedPoints.Contains(endPoint))
            {
              addedPoints.Add(endPoint);
            }
          }
        }
        List<Point3d> sortedPoints = addedPoints.OrderBy(point => point.X).ThenBy(point => point.Y).ToList();
        polyline.AddRange(sortedPoints);
        polyline = polyline.Count > 0 ? polyline : null;

        result.Add(polyline);
      }
      return result;
    }


    public List<List<double>> SplitGroup(List<double> elements, int group, int chunkSize)
    {
      List<List<double>> subLists = new List<List<double>>();
      for (int i = 0; i < group; i++)
      {
        List<double> subList = elements.Skip(i * chunkSize).Take(chunkSize).ToList();
        subLists.Add(subList);
      }

      return subLists;
    }

    public static double Remap(double value, double fromLow, double fromHigh, double toLow, double toHigh)
    {
      // 确保输入值在源区间内
      value = Math.Max(Math.Min(value, fromHigh), fromLow);

      // 计算百分比
      double fromRange = fromHigh - fromLow;
      double toRange = toHigh - toLow;
      double percent = (value - fromLow) / fromRange;

      // 应用映射
      double remappedValue = toLow + percent * toRange;

      // 四舍五入到一位小数
      return Math.Round(remappedValue, 1);
    }

    public double DataProcess()
    {
      double fitness = 0;

      List<List<double>> subLists = SplitGroup(GenePool, 3, RoomName.Count * 4);

      //拆成y1,Kc, Gc三组
      List<double> paraY1 = subLists[0];
      List<double> paraKc = subLists[1];
      List<double> paraGc = subLists[2];

      //y1的取值范围[0.6, 1.6]
      List<double> y1 = paraY1.Select(x => Remap(x, 0.1, 1, 0.6, 1.6)).ToList();
      //kc的取值范围[0.5, 0.9]
      List<double> Kc = paraKc.Select(x => Remap(x, 0.1, 1, 0.5, 0.9)).ToList();
      //gc的取值范围[0.3, 0.6]
      List<double> Gc = paraGc.Select(x => Remap(x, 0.1, 1, 0.3, 0.6)).ToList();

      Y1 = ConvertToTree(SplitGroup(y1, 4, RoomName.Count));
      KC = ConvertToTree(SplitGroup(Kc, 4, RoomName.Count));
      GC = ConvertToTree(SplitGroup(Gc, 4, RoomName.Count));


      List<List<double>> eachDirection = SplitGroup(Kc, 4, RoomName.Count);


      fitness = 2.2 * (CalculateWest(eachDirection[0]) + CalculateNorth(eachDirection[1]) +
        CalculateEast(eachDirection[2]) + CalculateSouth(eachDirection[3])) +
        1.0 * CalculateHeight(Y1) +
        0.3 * CalculateRoomDaylightFactor(GC, KC);


      return fitness;
    }


    public DataTree<double> ConvertToTree(List<List<double>> listValue)
    {
      DataTree<double> result = new DataTree<double>();

      for (int i = 0; i < listValue.Count; i++)
      {
        result.AddRange(listValue[i], new GH_Path(i));
      }

      return result;
    }

    public double CalculateWest(List<double> values)
    {
      double score = 0.0;
      //西侧的墙
      List<Polyline> pls = FloorPolylines.Branch(0);

      for (int i = 0; i < pls.Count; i++)
      {
        if (pls[i] != null)
        {
          if (values[i] == 0.9)
            score += 1;
          else if (values[i] == 0.8)
            score += 2;
          else if (values[i] == 0.7)
            score += 3;
          else if (values[i] == 0.6)
            score += 4;
          else if (values[i] == 0.5)
            score += 5;
          else
            score += 0;
        }
      }
      return score;
    }

    public double CalculateNorth(List<double> values)
    {
      double score = 0.0;
      //北侧的墙
      List<Polyline> pls = FloorPolylines.Branch(1);

      for (int i = 0; i < pls.Count; i++)
      {
        if (pls[i] != null)
        {
          if (values[i] == 0.9)
            score += 5;
          else if (values[i] == 0.8)
            score += 4;
          else if (values[i] == 0.7)
            score += 3;
          else if (values[i] == 0.6)
            score += 2;
          else if (values[i] == 0.5)
            score += 1;
          else
            score += 0;
        }
      }
      return score;
    }

    public double CalculateEast(List<double> values)
    {
      double score = 0.0;
      //东侧的墙
      List<Polyline> pls = FloorPolylines.Branch(2);

      for (int i = 0; i < pls.Count; i++)
      {
        if (pls[i] != null)
        {
          if (values[i] == 0.9)
            score += 1;
          else if (values[i] == 0.8)
            score += 2;
          else if (values[i] == 0.7)
            score += 3;
          else if (values[i] == 0.6)
            score += 2;
          else if (values[i] == 0.5)
            score += 1;
          else
            score += 0;
        }
      }
      return score;
    }

    public double CalculateSouth(List<double> values)
    {
      double score = 0.0;
      //南侧的墙
      List<Polyline> pls = FloorPolylines.Branch(3);

      for (int i = 0; i < pls.Count; i++)
      {
        if (pls[i] != null)
        {
          if (values[i] == 0.9)
            score += 5;
          else if (values[i] == 0.8)
            score += 4;
          else if (values[i] == 0.7)
            score += 3;
          else if (values[i] == 0.6)
            score += 2;
          else if (values[i] == 0.5)
            score += 1;
          else
            score += 0;
        }
      }
      return score;
    }


    public double CalculateHeight(DataTree<double> values)
    {
      double score = 0.0;

      for (int i = 0; i < FloorPolylines.BranchCount; i++)
      {
        List<Polyline> pls = FloorPolylines.Branch(i);

        for (int j = 0; j < pls.Count; j++)
        {
          if (pls[j] != null)
          {
            if (values.Branch(i)[j] < 1.2)
              score += 1;
            else if (values.Branch(i)[j] == 1.2)
              score += 5;
            else if (values.Branch(i)[j] == 1.3)
              score += 4;
            else if (values.Branch(i)[j] == 1.4)
              score += 3;
            else if (values.Branch(i)[j] > 1.4)
              score += 1;
            else
              score += 0;
          }
        }
      }
      return score;
    }


    public double CalculateRoomDaylightFactor(DataTree<double> gcValues, DataTree<double> kcValues)
    {
      double score = 0.0;


      for (int i = 0; i < FloorPolylines.BranchCount; i++)
      {
        List<Polyline> pls = FloorPolylines.Branch(i);

        for (int j = 0; j < pls.Count; j++)
        {
          if (pls[j] != null)
          {
            double daylightFactor = CavMatrix[RemapGC(gcValues.Branch(i)[j]), RemapKC(kcValues.Branch(i)[j])];
            score += CalculateScore(5, daylightFactor, DayLightFactor[j]);
          }
        }

      }
      return score;
    }


    int RemapKC(double kc)
    {
      if (kc == 0.5)
        return 0;
      if (kc == 0.6)
        return 1;
      if (kc == 0.7)
        return 2;
      if (kc == 0.8)
        return 3;
      if (kc == 0.9)
        return 4;
      return 0;
    }

    int RemapGC(double gc)
    {
      if (gc == 0.3)
        return 0;
      if (gc == 0.4)
        return 1;
      if (gc == 0.5)
        return 2;
      if (gc == 0.6)
        return 3;
      return 0;
    }
    public static double CalculateScore(double score, double x, double a)
    {
      //x:根据gc与kc算出来的采光系数
      //a:该房间类型应该的采光系数，是一个用户输入值
      // 计算x与a的差值
      double difference = Math.Abs(x - a);

      // 如果差值在0.5之内，得分为score分
      if (difference <= 0.5)
      {
        return score;
      }
      else
      {
        // 否则，根据距离远近逐渐减少得分
        // 这里使用一个简单的线性减分逻辑，您可以根据需要调整
        double maxScore = score; // 最大得分
        double minScore = -score; // 最小得分
        double maxDifference = 2.0; // 最大差值，根据需要调整

        // 计算得分，使用线性插值
        double value = Math.Round(maxScore - (difference / maxDifference) * (maxScore - minScore));

        return value;
      }
    }

  }
# ---------- end c_script ----------
extr = Extrude(Base=crv, Direction=Z)
panel_2 = Panel(c_script.Fitness)
galapagos = Galapagos(fitness=c_script, gene=genes)
panel_3 = Panel("{1;}")
branch_2 = TreeBranch(Tree=c_script.A, Path="{2;}", MaintainPaths=True)
crv_2 = Curve(branch_2)
crv_3 = Curve(c_script.B)
Z_2 = UnitZ(Factor=c_script.y1)
crv_4 = Curve(c_script.FloorPolyLines)
number_slider_3 = Slider(0.5, range=0..1)
multiplication_2 = Multiplication(A="2.8", B=c_script.Gc)
move_3 = Move(Geometry=crv_4, Motion=Z_2)  # -> Geometry, Transform
curvepoint = PointOnCurve(move_3.Geometry, parameter=0.5)
division = Division(A=c_script.Kc, B="2")
pdecon = Deconstruct(Point=curvepoint)  # -> XComponent, YComponent, ZComponent
addition = Addition(A=number_slider_3, B=division)
subtraction = Subtraction(A=number_slider_3, B=division)
addition_2 = Addition(A=pdecon.ZComponent, B=multiplication_2)
eval = EvaluateCurve(Curve=reparameterize(move_3.Geometry), Parameter=subtraction)  # -> Point, Tangent, Angle
pt = ConstructPoint(XCoordinate=pdecon.XComponent, YCoordinate=pdecon.YComponent, ZCoordinate=addition_2)
eval_2 = EvaluateCurve(Curve=reparameterize(move_3.Geometry), Parameter=addition)  # -> Point, Tangent, Angle
rec_3pt = Rectangle3Pt(PointA=eval_2.Point, PointB=eval.Point, PointC=pt)  # -> Rectangle, Length

# ==== cluster Cluster
txt = ClusterInput()
txt_2 = ClusterInput()
brep = ClusterInput()
brep_2 = ClusterInput()
int = ClusterInput()
txt_3 = Text(txt)
txt_4 = Text(txt_2)
brep_3 = Brep(brep)
brep_4 = Brep(brep_2)
int_2 = Integer(int)
txt_5 = Text(txt_4)
trim = TextTrim(Text=txt_3, Start=True, End=True)
len = TextLength(Text=txt_5)
min = Minimum(A="8", B=len)
fragment = TextFragment(Text=txt_5, Start="0", Count=min)
tmatch = MatchText(Text=fragment, Pattern="&&HALL&&", Case=True)
long = LongestList(ListA=tmatch, ListB="0", ListC="8", PaddingMode=2)  # -> ListA, ListB, ListC
brep_5 = Brep(brep_4)
brep_6 = Brep(brep_3)

# ---- group: Connections display
split = TextSplit(Text=trim, Separators="-,")
trim_2 = TextTrim(Text=split, Start=True, End=True)  # -> simplify(Result)
lng = ListLength(List=trim_2)  # -> expr("x-1", Length)
cull_i = CullIndex(List=trim_2, Indices=lng, Wrap=False)
int_3 = Integer(split)
dispatch = Dispatch(List=int_3, DispatchPattern=[True, False])  # -> ListA, ListB
item = ListItem(List=brep_6, Index=expr("x", dispatch.ListA), Wrap=True)
item_2 = ListItem(List=brep_6, Index=expr("x", dispatch.ListB), Wrap=True)
center = Center(Geometrical=item)  # -> Center, Dimension
center_2 = Center(Geometrical=item_2)  # -> Center, Dimension
ln = Line(StartPoint=center.Center, EndPoint=center_2.Center)
previewlw = CustomPreviewLineweights(Geometry=ln, Shader=ColourSwatch(SwatchColor=RGB(43, 43, 43)), Thickness=Slider(0.051, range=0..1), Absolute=True)

# ----
p_n_c = PickNChoose(Pattern=tmatch, Stream0=long.ListB, Stream1=long.ListC)
fragment_2 = TextFragment(Text=txt_5, Start=p_n_c)
txt_6 = Text(fragment_2)

# ---- group: Missing Adj Dots display
equals = Equality(FirstNumber=int_2, SecondNumber=0)  # -> Equality, Inequality
cull = CullPattern(List=brep_6, CullPattern=equals.Inequality)
center_3 = Center(Geometrical=cull)  # -> Center, Dimension
cir = Circle(Plane=center_3.Center, Radius=0.45)
boundary = BoundarySurfaces(Edges=cir)
previewlw_2 = CustomPreviewLineweights(Geometry=boundary, Shader=ColourSwatch(SwatchColor=RGB(227, 0, 0)), Absolute=False)

# ---- group: Names & Centers display
bbox = BoundingBox(Content=brep_6, Plane=PlaneXY(0, 0, 0))  # -> Box, Box_2
box_corners = BoxCorners(Box=bbox.Box)  # -> CornerA, CornerB, CornerC, CornerD, CornerE, CornerF, CornerG, CornerH
center_4 = Center(Geometrical=brep_6)  # -> Center, Dimension
text = DefineText(Text=txt_6, Plane=box_corners.CornerA, Size=".5", Font="IBM Plex Sans Condensed Medium")
previewlw_3 = CustomPreviewLineweights(Geometry=[center_4.Center, text], Shader=ColourSwatch(SwatchColor=RGB(0, 0, 0)), Absolute=False)

# ---- group: Corridors display
hsl = ColourHSL(Alpha=1, Hue=0, Saturation=0, Luminance=Slider(1, range=0..1))
previewmat = CustomPreviewMaterials(Geometry=brep_5, DiffuseColor=hsl)

# ---- group: House Edges DISPLAY
join = BrepJoin(Breps=flatten([brep_5, brep_6]))  # -> Breps, Closed
edges = BrepEdges(Brep=join.Breps)  # -> Naked, Interior, NonManifold
number_slider = Slider(0.104, range=0..4)
crv = Curve(edges.Naked)
join_2 = JoinCurves(Curves=crv, Preserve=False)
offset = Offset(Curve=flatten(join_2), Distance=expr("x/2", number_slider), Plane=PlaneXY(0, 0, 0), Corners=1)
previewlw_4 = CustomPreviewLineweights(Geometry=flatten(offset), Shader=ColourSwatch(SwatchColor=RGB(0, 0, 0)), Thickness=number_slider, Absolute=True)

# ---- group: Room colors display
lng_2 = ListLength(List=brep_6)
division = Division(A=".5", B=lng_2)
series = Series(Start=0, Step=division, Count=lng_2)
addition = Addition(A=series, B=Slider(0.108, range=0..1))
long_2 = LongestList(ListA=tmatch, ListB=Slider(0.637, range=0..1), ListC="1", PaddingMode=2)  # -> ListA, ListB, ListC

# ----
p_n_c_2 = PickNChoose(Pattern=tmatch, Stream0=long_2.ListB, Stream1=long_2.ListC)

# ---- group: Room colors display (continued)
hsl_2 = ColourHSL(Alpha=1, Hue=addition, Saturation=1, Luminance=p_n_c_2)
previewmat_2 = CustomPreviewMaterials(Geometry=brep_6, DiffuseColor=hsl_2)

# ---- group: Rooms Edges DISPLAY
crv_2 = Curve(simplify(brep_6))
subtraction = Subtraction(A=hsl_2, B=ColourSwatch(SwatchColor=RGB(71, 71, 71)))  # -> simplify(Result)
previewlw_5 = CustomPreviewLineweights(Geometry=crv_2, Shader=subtraction, Thickness=Slider(0.049, range=0..4), Absolute=True)
